vi "Main.gviweb"   [LabVIEW NXG 3.1.0]
panel controls:
  "Send Log": bool
  "Stop Test": bool
  "Start Test": bool
  "System": i32
panel indicators:
  "Files Sent": f64
  "Buffer": f64
  "Temperature History": f64[][]
  "Testing": bool
  "System Status": string
  "Memory Percentage Used": f64
  "Disk Percentage Used": f64
  "Temperature Current Values": f64[]
  "Application Status": string
  "Last Updated": timestamp
uses:
  NI::Skyline::Configuration::Open Configuration.gvi
  Application::Filter Systems by Package.gviweb
  Application::Get Minion ID.gviweb
  Application::Get Hostname.gviweb
  NI::Skyline::TagHTTP::Configure Tag History Window (Count).gvi
  NI::Skyline::TagHTTP::Multi Read History.gvi
  NI::Skyline::TagHTTP::Multi Read.gvi
  NI::Skyline::MessageHTTP::Open.gvi
  NI::Skyline::MessageHTTP::Publish.gvi
  NI::Skyline::MessageHTTP::Close.gvi
diagram:
  w1 = ""  # Server
  call "Open Configuration.gvi"(server url=w1, username="", password="") -> (configuration=w2, error out=w3)
  call "Filter Systems by Package.gviweb"(configuration in=w2, package="crio-test-cell", error in=w3) -> (configuration out=w4, systems=w5, error out=w6)
  for {
    w7 = each element of w5
    Property Node(instance in=w7) -> ("alias"=w9)
    append w9 to w8
  }
  Property Node(instance in=reference to "System", "Items"=w8, "Value"=0, error in=w6) -> (error out=w10)
  while {
    Property Node(instance in=reference to "System", error in=w10) -> ("Items"=w11)
    Array Index(array=w11) -> (out0[$System]=w12)
    call "Get Minion ID.gviweb"(configuration in=w4, hostname=w12) -> (configuration out=w13, id=w14, error out=w15)
    event (timeout = 500) {
      on Timeout {
        call "Get Hostname.gviweb"(configuration in=w13, minionID=w14, error in=w15) -> (configuration out=w16, Connection=w17, error out=w18)
        case (w17) {
          frame "Disconnected", Default {
            Property Node(instance in=reference to "Testing", "Value"=FALSE)
            w19 = TRUE
          }
          frame "Connected" {
            Get Current Time() -> (current time=w20)
            call "Read AI.gviweb"(configuration=w16, minion id=w14) -> (tags=w21, number of tags=w22)
            Time Stamp Subtract(x=w20, y=1000) -> w23
            case (w22) {
              frame 0 {
                w24 = f64[][] []
                w25 = f64[] []
              }
              frame 1, Default {
                call "Configure Tag History Window (Count).gvi"(start=w23, end=w20, newest first?=FALSE) -> (history window=w26)
                call "Multi Read History.gvi"(tags in=w21, tag history window=w26) -> (values=w27)
                call "Multi Read.gvi"(tags in=w21) -> (tag clusters=w28)
                for {
                  w29 = each element of w27
                  w30 = each element of w28
                  Property Node(instance in=w29) -> ("Values"=w31)
                  for {
                    w32 = each element of w31
                    Scan Value(format string="%f", string=w32) -> (value=w34)
                    append w34 to w33
                  }
                  Property Node(instance in=w30) -> ("Value"=w35)
                  Scan Value(format string="%f", string=w35) -> (value=w36)
                  append w33 to w24
                  append w36 to w25
                }
              }
            }
            $"Temperature History" <- w24
            $"Temperature Current Values" <- w25
            call "Read Health.gviweb"(configuration=w16, minion id=w14) -> (tags=w37)
            for {
              w38 = each element of w37
              Property Node(instance in=w38) -> ("Path"=w39, "Value"=w40, "Time Stamp"=w41)
              Search Or Split String(search string/char=".", string=w39) -> (match + rest of string=w42)
              case (w42) {
                frame ".Health.Disk.UsePercentage" {
                  Scan Value(format string="%f", string=w40) -> (value=w43)
                  $"Disk Percentage Used" <- w43
                }
                frame ".Health.Memory.UsePercentage" {
                  Scan Value(format string="%f", string=w40) -> (value=w44)
                  $"Memory Percentage Used" <- w44
                }
                frame ".cRIO_Test_Cell.files_sent" {
                  Scan Value(format string="%d", string=w40) -> (value=w45)
                  $"Files Sent" <- w45
                }
                frame ".cRIO_Test_Cell.buffer" {
                  Scan Value(format string="%d", string=w40) -> (value=w46)
                  $Buffer <- w46
                }
                frame ".cRIO_Test_Cell.testing" {
                  case (w40) {
                    frame "False", Default {
                      w47 = FALSE
                    }
                    frame "True" {
                      w47 = TRUE
                    }
                  }
                  $Testing <- w47
                }
                frame ".cRIO_Test_Cell.status" {
                  $"Application Status" <- w40
                  $"Last Updated" <- w41
                }
                frame Default { }
              }
            }
            w19 = FALSE
          }
        }
        Property Node(instance in=reference to "Stop Test", "Disabled"=w19)
        $"System Status" <- w17
        Property Node(instance in=reference to "Start Test", "Disabled"=w19)
        Property Node(instance in=reference to "Send Log", "Disabled"=w19)
      }
      on "Send Log" Value changed {
        call "Open.gvi"(configuration=w13) -> (message session out=w48, error out=w49)
        call "Publish.gvi"(message session=w48, topic=w14, message="Send File", error in=w49) -> (message session out=w50, error out=w51)
        call "Close.gvi"(message session=w50, error in=w51)
      }
      on "Start Test" Value changed {
        call "Open.gvi"(configuration=w13) -> (message session out=w52, error out=w53)
        call "Publish.gvi"(message session=w52, topic=w14, message="Start Test", error in=w53) -> (message session out=w54, error out=w55)
        call "Close.gvi"(message session=w54, error in=w55)
      }
      on "Stop Test" Value changed {
        call "Open.gvi"(configuration=w13) -> (message session out=w56, error out=w57)
        call "Publish.gvi"(message session=w56, topic=w14, message="Stop Test", error in=w57) -> (message session out=w58, error out=w59)
        call "Close.gvi"(message session=w58, error in=w59)
      }
      on "System" Value changed {
        Property Node(instance in=reference to "Files Sent", "Value"=0)
        Property Node(instance in=reference to "Buffer", "Value"=0)
        Property Node(instance in=reference to "Application Status", "Value"="")
        Property Node(instance in=reference to "Testing", "Value"=FALSE)
        Property Node(instance in=reference to "Last Updated", "Value"=1904-01-01T00:00:00Z)
      }
    }
    stop if FALSE
  }
